# Grasshopper definition LayFlatForLaser.gh (Grasshopper 1.0.7)
# plug-ins: Heteroptera, Pufferfish

brep = Brep([<brep referenced from the Rhino model> x6])
debrep = DeconstructBrep()  # -> Faces, Edges, Vertices; disabled
item = ListItem(List=brep, Index=Slider(0, range=0..10), Wrap=True)
area = Area(Geometry=debrep.Faces)  # -> Area, Centroid
debrep_2 = DeconstructBrep(Brep=item)  # -> Faces, Edges, Vertices
int = Integer(simplify(area.Area))
area_2 = Area(Geometry=debrep_2.Faces)  # -> Area, Centroid
extremums = MinMax(Number=int)  # -> Minimum, Maximum
int_2 = Integer(simplify(flatten(area_2.Area)))
int_3 = Integer(extremums.Maximum)
extremums_2 = MinMax(Number=int_2)  # -> Minimum, Maximum
mindex = MemberIndex(Set=int, Member=int_3)  # -> Index, Count
int_4 = Integer(extremums_2.Maximum)
item_2 = ListItem(List=mindex.Index, Index=0, Wrap=True)
mindex_2 = MemberIndex(Set=int_2, Member=int_4)  # -> Index, Count
item_3 = ListItem(List=debrep.Faces, Index=item_2, Wrap=True)
item_4 = ListItem(List=mindex_2.Index, Index=0, Wrap=True)
dim = Dimensions(Surface=item_3)  # -> UDimension, VDimension
ma = MassAddition(Input=flatten(dim.VDimension))  # -> Result, PartialResults
item_5 = ListItem(List=debrep_2.Faces, Index=item_4, Wrap=True)
ins = InsertItems(List=ma.PartialResults, Item=0, Indices=0, Wrap=True)
X = UnitX(Factor=expr("x", ins))
dim_2 = Dimensions(Surface=item_5)  # -> UDimension, VDimension
move = Move(Geometry=item_3, Motion=graft(X))  # -> Geometry, Transform
X_2 = UnitX(Factor=dim_2.VDimension)
panel = Panel(ins)
brep_2 = Brep(move.Geometry)
move_2 = Move(Geometry=item_5, Motion=X_2)  # -> Geometry, Transform
debrep_3 = DeconstructBrep(Brep=brep_2)  # -> Faces, Edges, Vertices
brep_3 = Brep(move_2.Geometry)
debrep_4 = DeconstructBrep(Brep=brep_3)  # -> Faces, Edges, Vertices
crv = Curve(debrep_3.Edges)
join = JoinCurves(Curves=debrep_4.Edges, Preserve=False)
yz = YZPlane(Origin=Point(0, 0, 0))
xz = XZPlane(Origin=Point(0, 0, 0))
crv_2 = Curve(join)
project = Project(Geometry=crv_2, Plane=xz)  # -> Geometry, Transform
project_2 = Project(Geometry=crv_2, Plane=PlaneXY(0, 0, 0))  # -> Geometry, Transform
project_3 = Project(Geometry=crv_2, Plane=yz)  # -> Geometry, Transform
join_2 = JoinCurves(Curves=project_3.Geometry, Preserve=False)
join_3 = JoinCurves(Curves=project_2.Geometry, Preserve=False)
join_4 = JoinCurves(Curves=project.Geometry, Preserve=False)
area_3 = Area(Geometry=join_4)  # -> Area, Centroid
area_4 = Area(Geometry=join_2)  # -> Area, Centroid
area_5 = Area(Geometry=join_3)  # -> Area, Centroid
item_6 = ListItem(List=area_3.Area, Index=0, Wrap=True)
item_7 = ListItem(List=area_4.Area, Index=0, Wrap=True)
item_8 = ListItem(List=area_5.Area, Index=0, Wrap=True)
yz_2 = YZPlane(Origin=Point(0, 0, 0))
xy = XYPlane(Origin=Point(0, 0, 0))
xz_2 = XZPlane(Origin=Point(0, 0, 0))
panel_2 = Panel([item_6, item_7, item_8])
merge = Merge(Data1=xz_2, Data2=yz_2, Data3=xy)
null = NullItem(Item=panel_2)  # -> NullFlags, InvalidFlags, Description
xy_2 = XYPlane(Origin=Point(0, 0, 0))
cull = CullPattern(List=merge, CullPattern=invert(null.NullFlags))
orient = Orient(Geometry=crv_2, Source=cull, Target=xy_2)  # -> Geometry, Transform
project_4 = Project(Geometry=orient.Geometry, Plane=PlaneXY(0, 0, 0))  # -> Geometry, Transform
brec = BoundingRectangle(Geometry=project_4.Geometry, Plane=PlaneXY(0, 0, 0), Axis=0, Slide=0, Union=True)  # -> Bounding, DimensionX, DimensionY
disc = Discontinuity(Curve=brec.Bounding, Level=1)  # -> Points, Parameters
item_9 = ListItem(List=disc.Points, Index=Slider(1, range=0..10), Wrap=True)
move2pt = MoveToPoint(Geometry=project_4.Geometry, PointA=item_9, PointB="{0,0,0}")  # -> Moved, Vector, Transform
